# Grasshopper definition udp.gh (Grasshopper 0.9.76)
# plug-ins: Python Interpreter, gHowl

number_slider = Slider(0, range=0..10)
pt = Point(<point referenced from the Rhino model>)
number_slider_2 = Slider(7.5, range=0..10)
directorypath_with_backslashes_no_spaces = Panel("C:\Users\patri\Desktop\braid-evolution\unity\interactive-braid-evolution\Assets\Geometry\test")  # "DirectoryPath with Backslashes NO SPACES and FileName Minus Extension"

# ---- group: Network configuration for recieving
ip_to_receive_on_this_computer = Panel("10.13.1.197")
port_to_receive_on = Panel("8051")
udp = UDPReceiver(Address=ip_to_receive_on_this_computer, Port=port_to_receive_on, Pattern=0)  # -> Info, Data
panel = Panel(udp.Info)

# ----
brep = Brep([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])
the_message_coming_from_unity = Panel(udp.Data)

pt_2 = ConstructPoint(XCoordinate=number_slider_2, YCoordinate=number_slider_2, ZCoordinate=number_slider_2)
division = Division(A=number_slider_2, B="2")
pt_3 = ConstructPoint(XCoordinate=number_slider, YCoordinate=number_slider, ZCoordinate=number_slider)
pdecon = Deconstruct(Point=pt)  # -> XComponent, YComponent, ZComponent
addition = Addition(A=division, B=pdecon.XComponent)
addition_2 = Addition(A=division, B=pdecon.YComponent)
addition_3 = Addition(A=division, B=pdecon.ZComponent)
pt_4 = ConstructPoint(XCoordinate=addition, YCoordinate=addition_2, ZCoordinate=addition_3)
box = Box2Pt(PointA=pt, PointB=pt_4, Plane=PlaneXY(0, 0, 0))
box_2 = Box2Pt(PointA=pt_3, PointB=pt_2, Plane=PlaneXY(0, 0, 0))

# ---- group: JSON decoder
json_loader = PythonScript(data=udp.Data)  # -> object
# ---------- json_loader: Python ----------
import json 

j = json.loads(data)

object = j
# ---------- end json_loader ----------

# ----
mcol = MeshColours(Mesh=box_2, Colours=ColourSwatch(SwatchColor=RGB(255, 255, 255)))

# ---- group: Model exporting
model_export = PythonScript(FileNameToSave=directorypath_with_backslashes_no_spaces, Brep=brep, jsonObject=json_loader)  # -> message; inputs Brep: list of Brep
# ---------- model_export: Python ----------
import rhinoscriptsyntax
import Rhino


if(jsonString == "Message from Unity"):
    FILE_NAME = FileNameToSave
    
    for q in range (0,len(Brep)):
      Rhino.RhinoDoc.ActiveDoc.Objects.AddBrep(Brep[q], Rhino.DocObjects.ObjectAttributes())
    
    rhinoscriptsyntax.Command("SelAll")
    rhinoscriptsyntax.Command("-Export " + FILE_NAME + ".obj y=n Enter Enter") #y=n turns off silly Y/Z axis swap! Use no spaces in the file path.
    rhinoscriptsyntax.Command("Delete Enter")
    
    message = True
else :
    message = False
# ---------- end model_export ----------

# ---- group: JSON encoder
json_encoder = PythonScript(exportSucess=model_export, jsonObject=json_loader)  # -> shouldExport, jsonString; inputs exportSucess: Boolean
# ---------- json_encoder: Python ----------
import json 



jsonString = json.dumps({
    'name': 'new_model', 
    'generation':'2', 
    'sucess': exportSucess
})
# ---------- end json_encoder ----------

# ---- group: Network configuration for sending
ip_to_send_to = Panel("10.13.1.197")
port_to_send_to = Panel("8050")
udp_2 = UDPSender(Address=ip_to_send_to, Port=port_to_send_to, Pattern=0, Data=json_encoder.jsonString)
panel_2 = Panel(udp_2)
